% Simulink data dictionary quadFlyProject_ap_params.sldd

acc_g = Simulink.Parameter(9.81, StorageClass="SimulinkGlobal", DataType="single", Unit="m/s^2")  % 重力加速度
L = Simulink.Parameter(0.318, StorageClass="SimulinkGlobal", DataType="single")  % 机臂长度
B = Simulink.Parameter(0.318, StorageClass="SimulinkGlobal", DataType="single", Unit="m")  % 机臂左右距离
m = Simulink.Parameter(1.4, StorageClass="SimulinkGlobal", DataType="single", Unit="kg")  % 飞机质量(kg)
Ixx = Simulink.Parameter(0.014, StorageClass="SimulinkGlobal", DataType="single", Unit="kg.m2")  % x轴转动惯量
Iyy = Simulink.Parameter(0.014, StorageClass="SimulinkGlobal", DataType="single", Unit="kg.m2")  % y轴转动惯量
max_gyro = Simulink.Parameter(0.9, StorageClass="SimulinkGlobal", DataType="single")  % 最大旋翼油门
max_lift = Simulink.Parameter(10, StorageClass="SimulinkGlobal", DataType="single", Unit="N")  % 旋翼单桨最大拉力(N)
max_rpm_rot = Simulink.Parameter(8797.5, StorageClass="SimulinkGlobal", DataType="single", Unit="rpm")  % 旋翼最大转速
min_thr = Simulink.Parameter(0, StorageClass="SimulinkGlobal", DataType="single")  % 最小油门
mc_max_tht = Simulink.Parameter(0.2, StorageClass="SimulinkGlobal", DataType="single", Unit="rad")  % 旋翼模式的最大俯仰角
mc_min_tht = Simulink.Parameter(-0.2, StorageClass="SimulinkGlobal", DataType="single", Unit="rad")  % 旋翼模式的最小俯仰角
mc_max_phi = Simulink.Parameter(0.2, StorageClass="SimulinkGlobal", DataType="single", Unit="rad")  % 最大滚转角
mc_max_hdot = Simulink.Parameter(3, StorageClass="SimulinkGlobal", DataType="single", Unit="m/s")  % 旋翼模式最大升降速度
mc_min_hdot = Simulink.Parameter(-3, StorageClass="SimulinkGlobal", DataType="single", Unit="m/s")  % 旋翼模式最小升降速度
mc_max_p = Simulink.Parameter(0.5, StorageClass="SimulinkGlobal", DataType="single", Unit="rad/s")  % 最大滚转角速率(rad/s)
mc_max_q = Simulink.Parameter(0.5, StorageClass="SimulinkGlobal", DataType="single", Unit="rad/s")  % 最大俯仰角速率(rad/s)
mc_max_r = Simulink.Parameter(0.2, StorageClass="SimulinkGlobal", DataType="single", Unit="rad/s")  % 最大偏航角速率(rad/s)
mc_max_az = Simulink.Parameter(14, StorageClass="SimulinkGlobal", DataType="single", Unit="m/s^2")  % 旋翼模式的最大法向加速度
mc_min_az = Simulink.Parameter(5, StorageClass="SimulinkGlobal", DataType="single", Unit="m/s^2")  % 旋翼模式的最小法向加速度
mc_max_v = Simulink.Parameter(4, StorageClass="SimulinkGlobal", DataType="single", Unit="m/s")  % 最大水平速度(m/s)
mc_max_vx = Simulink.Parameter(5, StorageClass="SimulinkGlobal", DataType="single", Unit="m/s")  % 最大前进速度(m/s)
mc_k_tht = Simulink.Parameter(1.2, StorageClass="SimulinkGlobal", DataType="single", Unit="rad/s")  % 俯仰角控制带宽
mc_k_phi = Simulink.Parameter(1.5, StorageClass="SimulinkGlobal", DataType="single", Unit="rad/s")  % 滚转角控制带宽
mc_k_psi = Simulink.Parameter(0.25, StorageClass="SimulinkGlobal", DataType="single", Unit="rad/s")  % 偏航角反馈增益因子
mc_k_p = Simulink.Parameter(7, StorageClass="SimulinkGlobal", DataType="single")  % 自适应kp
mc_k_q = Simulink.Parameter(7, StorageClass="SimulinkGlobal", DataType="single")  % 自适应kq
mc_k_r = Simulink.Parameter(2.5, StorageClass="SimulinkGlobal", DataType="single")  % 自适应kr
mc_Gamma_L1 = Simulink.Parameter(2500, StorageClass="SimulinkGlobal", DataType="single")  % 自适应增益
mc_w_p = Simulink.Parameter(7, StorageClass="SimulinkGlobal", DataType="single", Unit="rad/s")  % 旋翼滚转角速度闭环控制频率(rad/s)
mc_w_q = Simulink.Parameter(7, StorageClass="SimulinkGlobal", DataType="single", Unit="rad/s")  % 旋翼俯仰角速度闭环控制频率(rad/s)
mc_w_r = Simulink.Parameter(2.5, StorageClass="SimulinkGlobal", DataType="single", Unit="rad/s")  % 旋翼偏航角速度闭环控制频率(rad/s)
mc_w_h = Simulink.Parameter(0.25, StorageClass="SimulinkGlobal", DataType="single")  % 高度控制闭环频率
mc_w_hdot = Simulink.Parameter(1.7, StorageClass="SimulinkGlobal", DataType="single", Unit="rad/s")  % 旋翼升降速率闭环控制频率
mc_zeta_hdot = Simulink.Parameter(0.8, StorageClass="SimulinkGlobal", DataType="single", Unit="rad/s")  % 旋翼升降速率闭环阻尼比
mc_w_hover = Simulink.Parameter(0.6, StorageClass="SimulinkGlobal", DataType="single", Unit="rad/s")  % 旋翼悬停闭环控制频率(rad/s)
mc_zeta_hover = Simulink.Parameter(0.8, StorageClass="SimulinkGlobal", DataType="single")  % 旋翼悬停闭环控制阻尼比
mc_w_x = Simulink.Parameter(0.225, StorageClass="SimulinkGlobal", DataType="single", Unit="rad/s")  % 旋翼位置闭环控制频率(rad/s)
trim_filter_num = Simulink.Parameter([0 0.005], StorageClass="SimulinkGlobal", DataType="single")  % 低通滤波器分子
trim_filter_den = Simulink.Parameter([1 -0.995], StorageClass="SimulinkGlobal", DataType="single")  % 低通滤波器分母
max_moment = Simulink.Parameter(0.14, StorageClass="SimulinkGlobal", DataType="single", Unit="Nm")  % 旋翼单桨最大扭矩(Nm)
max_thr = Simulink.Parameter(0.8, StorageClass="SimulinkGlobal", DataType="single")  % 最大油门
Izz = Simulink.Parameter(0.026, StorageClass="SimulinkGlobal", DataType="single", Unit="kg*m2")  % z轴转动惯量