% Simulink data dictionary quadFly.sldd
% references quadFlyProject_ap_params.sldd

HILGPS = Simulink.Bus()
  fix_type: uint8
  satellites_visible: uint8
  lat: int32
  lon: int32
  alt: int32
  hAcc: uint32
  vAcc: uint32
  velN: int32
  velE: int32
  velD: int32
  gSpeed: int32
  headMot: int32
  headVeh: int32

Kd_RP_AgngleRate = 0.005
Kd_YAW_AngleRate = 0.05
Ki_RP_AgngleRate = 0.01
Ki_YAW_AngleRate = 0.8
Kp_RP_ANGLE = 6.5
Kp_RP_AgngleRate = 0.55
Kp_YAW_AngleRate = 3.2
MAX_CONTROL_ANGLE_PITCH = 35
MAX_CONTROL_ANGLE_RATE_PITCH = 220
MAX_CONTROL_ANGLE_RATE_ROLL = 220
MAX_CONTROL_ANGLE_RATE_RP = 180
MAX_CONTROL_ANGLE_RATE_Y = 90
MAX_CONTROL_ANGLE_ROLL = 35
MAX_CONTROL_ANGLE_RP = 45
MAX_CONTROL_ANGLE_Y = 180

MavLinkGPS = Simulink.Bus()
  time_usec: uint32
  lat: int32
  lon: int32
  alt: int32
  eph: uint16
  epv: uint16
  vel: uint16
  vn: int16
  ve: int16
  vd: int16
  cog: uint16
  fix_type: uint8
  satellites_visible: uint8

MavLinkSensor = Simulink.Bus()
  time_usec: uint32
  xacc: single
  yacc: single
  zacc: single
  xgyro: single
  ygyro: single
  zgyro: single
  xmag: single
  ymag: single
  zmag: single
  abs_pressure: single
  diff_pressure: single
  pressure_alt: single
  temperature: single
  fields_updated: uint32

MavLinkStateQuat = Simulink.Bus()
  time_usec: uint32
  attitude_quaternion: single[4]
  rollspeed: single
  pitchspeed: single
  yawspeed: single
  lat: int32
  lon: int32
  alt: int32
  vx: int16
  vy: int16
  vz: int16
  ind_airspeed: uint16
  true_airspeed: uint16
  xacc: int16
  yacc: int16
  zacc: int16

ModelInit_AngEuler = [0 0 0]
ModelInit_PosE = [0 0 0]
ModelInit_RPM = 0
ModelInit_RateB = [0 0 0]
ModelInit_VelB = [0 0 0]
ModelParam_GPSLatLong = [40.1540302 116.2593683]
ModelParam_GlobalNoiseGainSwitch = 1
ModelParam_envAltitude = -41.526
ModelParam_envGravityAcc = 9.8
ModelParam_envLatitude = 40.1540302
ModelParam_envLongitude = 116.2593683
ModelParam_motorCr = 1148
ModelParam_motorJm = 0.0001287
ModelParam_motorMinThr = 0.05
ModelParam_motorT = 0.02
ModelParam_motorWb = -141.4
ModelParam_rotorCm = 1.779e-7
ModelParam_rotorCt = 1.105e-5
ModelParam_uavCCm = [0.01 0.01 0.0055]
ModelParam_uavCd = 0.073
ModelParam_uavDearo = 0.12
ModelParam_uavJ = [0.0211 0 0; 0 0.0219 0; 0 0 0.0366]
ModelParam_uavJxx = 0.0211
ModelParam_uavJyy = 0.0219
ModelParam_uavJzz = 0.0366
ModelParam_uavMass = 1.4
ModelParam_uavMotNumbs = int8(4)
ModelParam_uavR = 0.225
ModelParam_uavType = int8(3)
Saturation_I_RP_Max = 0.3
Saturation_I_RP_Min = -0.3
Saturation_I_Y_Max = 0.2
Saturation_I_Y_Min = -0.2
THR_HOVER = 0.609
initVars = {"initVars"; "mdl_name"}
mdl_name = "quadFlyProject"
tout = [0; 0.001; 0.002; 0.003; 0.004; 0.005; 0.006; 0.007; 0.008; 0.009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 3.031]
Sig = Simulink.Signal()
Sig1 = Simulink.Signal()
Sig2 = Simulink.Signal()
Sig3 = Simulink.Signal()
qdot_q = Simulink.Parameter([])
qdot_c0 = Simulink.Parameter([])
Sig4 = Simulink.Signal()
Sig5 = Simulink.Signal()
ModelParam_BusSampleRate = 0.001

C2 = Simulink.Bus()  % 指令总线
  thr_cmd: single  % 油门指令
  rot_heave: single  % 悬停转速
  rot_yaw: single
  rot_roll: single
  rot_pitch: single  % 俯仰控制需要的电机转速比例，小于1，表示与最大转速的比值
  pdot_c: single
  qdot_c: single
  rdot_c: single
  p_c: single
  q_c: single
  r_c: single
  thr_rc: single, Min=1100, Max=1900  % 遥控器油门指令
  dr_rc: single, Min=1100, Max=1900  % 遥控器方向舵指令
  de_rc: single, Min=1100, Max=1900  % 遥控器升降舵指令
  da_rc: single, Min=1100, Max=1900  % 遥控器副翼指令

params_bus = Simulink.Bus()  % 控制律参数
  qdot_q: single
  qdot_max: single
  qdot_c0: single
  Omega_L1: single
  K_L1: single
  Gamma_L1: single
  Max_omega: single
  dt: single

dt = Simulink.Parameter(0.001, DataType="single")
max_omega = Simulink.Parameter(3, DataType="single")
qdot_max = Simulink.Parameter([], DataType="single")
c2init = struct(de_rc=1500, da_rc=1500, dr_rc=1500, thr_rc=1100)

sensors = Simulink.Bus()  % 传感器参数
  p: single, Unit="rad/s"  % 滚转角速率
  q: single, Unit="rad/s"  % 俯仰角速度
  r: single, Unit="rad/s"  % 偏航角速度
  phi: single, Unit="rad"  % 滚转角
  tht: single, Unit="rad"  % 俯仰角
  posi: single, Unit="rad"  % 偏航角